# Grasshopper definition S5-graph-stripper-custom-3.gh (Grasshopper 1.0.8)
# plug-ins: MeshEdit Components, Human, Tree8

mplane = MeshPlane(Boundary={Plane=PlaneXY(0, 0, 0), Size=Domain2(u=-10..10, v=-10..10)}, WidthCount=10, HeightCount=10)  # -> Mesh, Area
number_slider = Slider(3, range=0..10)
msphereex = MeshSphereEx(Base=PlaneXY(0, 0, 0), Radius=10, Count=5)
graphs_05_stripper_custom = FilePath("C:\Users\jaume\Documents\GitHub\MPDA25-Session05\graphs\graphs-05-stripper-custom.py")
make_sure_is_the_right_path = Panel(graphs_05_stripper_custom)
quadmesh = Mesh(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)
enneper = Data(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)
trimesh = Mesh(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)
mplane_2 = MeshPlane(
    Boundary={Plane=PlaneXY(0, 0, 0), Size=Domain2(u=-10..10, v=-10..10)},
    WidthCount=number_slider,
    HeightCount=number_slider)  # -> Mesh, Area
input_mesh = Mesh(msphereex)
file = ReadFile(File=graphs_05_stripper_custom, PerLineParse=False)
preview = CustomPreview(Geometry=input_mesh, Material=ColourSwatch(SwatchColor=RGBA(122, 122, 122, 50)))
demesh = DeconstructMesh(Mesh=input_mesh)  # -> Vertices, Faces, Colours, Normals
py3 = Python3Script(script=file, m=input_mesh, s=Slider(5, range=0..10))  # -> out, a, b, c; inputs m: Mesh, s: Int32; unedited script template
conmesh = ConstructMesh(Vertices=demesh.Vertices, Faces=graft(demesh.Faces))  # -> flatten(Mesh)
pline = PolyLine(Vertices=py3.b, Closed=False)
panel = Panel(py3.a)
item = ListItem(List=conmesh, Index=py3.a, Wrap=True)
pline_2 = PolyLine(Vertices=py3.b, Closed=False)  # -> flatten(Polyline)
clean = CombineClean(Meshes=item)  # -> flatten(Mesh)
lng = ListLength(List=pline_2)
area = Area(Geometry=conmesh)  # -> Area, Centroid
wheel = ColourWheel(
    lng,
    ColourGrips_Style=30,
    ColourGrips_Grip=[0, 2.094395102, 4.188790205, 3.141592654],
    ColourGrips_Lum=[0.1, 0.5],
    ColourGrips_Range=[0.2617993878, 0.2617993878, 0.2617993878, 0.2617993878],
    ColourGrips_Sat=[0.2, 0.6])
all_shortest_paths = Data(py3.a)
meshfacepoints = Data(area.Centroid)
mesh = Data(input_mesh)
item_2 = ListItem(List=pline_2, Index=Slider(52, range=0..100), Wrap=True)
previewlw = CustomPreviewLineweights(Geometry=pline_2, Shader=wheel, Thickness=Slider(2, range=0..2), Absolute=False)
explode = Explode(Curve=pline_2, Recursive=True)  # -> Segments, Vertices
item_3 = ListItem(List=meshfacepoints, Index=all_shortest_paths, Wrap=True)
pline_3 = PolyLine(Vertices=item_3, Closed=False)

# ---- group: filter by length
explode_2 = Explode(Curve=pline_3, Recursive=True)  # -> Segments, Vertices
lng_2 = ListLength(List=explode_2.Segments)
smaller = SmallerThan(FirstNumber=lng_2, SecondNumber=Slider(8, range=0..10))  # -> SmallerThan, OrEqualTo

# ----
viewer = ParamViewer(all_shortest_paths)

# ---- group: assignment template
py3_2 = Python3Script(all_shortest_paths=all_shortest_paths, mesh=mesh, MeshFacePoints=meshfacepoints)  # -> out, selected_shortest_path; inputs all_shortest_paths: tree, mesh: tree, MeshFacePoints: tree
# ---------- py3_2: Python ----------
import ghpythonlib.treehelpers as th # type: ignore

#convert all_shortest_paths tree to python list
all_shortest_path = th.tree_to_list(all_shortest_paths)







#this is the end result: one list of integers that represent face indexes
# a = selected_shorest_path
# ---------- end py3_2 ----------

# ----
weldvertices = MeshWeldVertices(Mesh=input_mesh, Tolerance=0.01)  # -> RuntimeMessage, Mesh
graphs_05_stripper_custom_2 = FilePath("C:\Users\jaume\Documents\GitHub\MPDA25-Session05\graphs\graphs--stripper-custon-JaumeMonclús.py")
clean_2 = CombineClean(Meshes=weldvertices.Mesh)
all_shortest_paths_2 = Data(py3.a)
seleted_shortest_path = Data(py3_2.selected_shortest_path)
cull = CullPattern(List=flatten(pline_3), CullPattern=flatten(smaller.SmallerThan))
cull_2 = CullPattern(List=clean, CullPattern=flatten(smaller.SmallerThan))
cull_3 = CullPattern(List=viewer, CullPattern=flatten(smaller.SmallerThan))
file_2 = ReadFile(File=graphs_05_stripper_custom_2, PerLineParse=False)
make_sure_is_the_right_path_2 = Panel(graphs_05_stripper_custom_2)

# ---- group: filter by straighness
explode_3 = Explode(Curve=cull, Recursive=True)  # -> Segments, Vertices
cull_i = CullIndex(List=explode_3.Segments, Indices="-1", Wrap=True)
shift = ShiftList(List=explode_3.Segments, Shift=1, Wrap=False)
angle = Angle(VectorA=cull_i, VectorB=shift)  # -> Angle, Reflex
avr = Average(Input=angle.Angle)  # -> flatten(ArithmeticMean)
nullrep = ReplaceNulls(Items=avr, Replacements="100")  # -> Items, Count

# ----
py3_3 = Python3Script(script=file_2, m=clean_2, s=all_shortest_paths_2, p=py3.b)  # -> out, a, compute_indexes, get_filtered_lists, compute_polylines, compute_distances, compute_sorting, unpack_branches_to_lists; inputs m: Mesh, s: tree of Int32, p: tree; unedited script template
sort = SortList(Keys=py3_3.compute_distances, ValuesA=py3_3.compute_polylines)  # -> Keys, ValuesA
panel_2 = Panel(py3_3.unpack_branches_to_lists)
end = EndPoints()  # -> Start, End
item_4 = ListItem(List=sort.ValuesA, Index=0, Wrap=True)
explode_4 = MeshExplode(Mesh=clean_2, Interpolate=False)
item_5 = ListItem(List=explode_4, Index=panel_2, Wrap=True)
sort_2 = SortList(Keys=flatten(nullrep.Items), ValuesA=flatten(cull_2), ValuesB=flatten(cull), ValuesC=flatten(cull_3))  # -> Keys, ValuesA, ValuesB, ValuesC
item_6 = ListItem(List=sort_2.ValuesA, Index=0, Wrap=True)
item_7 = ListItem(List=sort_2.ValuesB, Index=0, Wrap=True)
item_8 = ListItem(List=sort_2.ValuesC, Index=0, Wrap=True)
tbranch = TreeBranch(Tree=all_shortest_paths, Path=item_8, MaintainPaths=True, SplitTree=False)
seleted_shortest_path_2 = Data(tbranch)
panel_3 = Panel(seleted_shortest_path_2)
