# Grasshopper definition S5-graph-stripper-custom.gh (Grasshopper 1.0.8)

number_slider = Slider(3, range=0..10)
graphs_05_stripper_custom = FilePath("C:\Users\jaume\Documents\GitHub\MPDA25-Session05\graphs\graphs-05-stripper-custom.py")
make_sure_is_the_right_path = Panel(graphs_05_stripper_custom)
quadmesh = Mesh(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)
enneper = Data(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)
trimesh = Mesh(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)
mplane = MeshPlane(
    Boundary={Plane=PlaneXY(0, 0, 0), Size=Domain2(u=-10..10, v=-10..10)},
    WidthCount=number_slider,
    HeightCount=number_slider)  # -> Mesh, Area
input_mesh = Mesh(enneper)
file = ReadFile(File=graphs_05_stripper_custom, PerLineParse=False)
py3 = Python3Script(script=file, m=input_mesh, s=Slider(2, range=0..10))  # -> out, a, b, c, d, e; inputs m: Mesh, s: Int32; unedited script template
pline = PolyLine(Vertices=py3.b, Closed=False)  # -> flatten(Polyline)
panel = Panel("PATHS")
panel_2 = Panel("MESH")
explode = Explode(Curve=pline, Recursive=True)  # -> Segments, Vertices
panel_3 = Panel(py3.d)
end = EndPoints(Curve=pline)  # -> Start, End
item = ListItem(List=pline, Index=0, Wrap=True)  # -> Item, Item1
vec = Vector(explode.Segments)
ln = Line(StartPoint=end.Start, EndPoint=end.End)
lng = ListLength(List=explode.Segments)
ma = MassAddition(Input=vec)  # -> Result, PartialResults
end_2 = EndPoints(Curve=item.Item)  # -> Start, End
number_slider_2 = Slider(119, range=0..338)
vec_2 = Vector(unitize(ln))
division = Division(A=ma.Result, B=lng)
pt = Point(end_2.Start)
vec_3 = Vector(division)
flatten = FlattenTree(Tree=vec_3, Path="{0}")
item_2 = ListItem(List=flatten, Index=number_slider_2, Wrap=True)
item_3 = ListItem(List=vec_2, Index=number_slider_2, Wrap=True)
vdis = VectorDisplay(Anchor=pt, Vector=item_3)
vdis_2 = VectorDisplay(Anchor=pt, Vector=item_2)
pl = ConstructPlane(Origin=pt, XAxis=item_3, YAxis=item_2)
len = Length(Curve=pline)
angle = Angle(VectorA=item_3, VectorB=item_2, Plane=pl)  # -> Angle, Reflex
deg = Degrees(Radians=angle.Angle)
addition = Addition(A=deg, B=len)
num = Number(addition)
